# Grasshopper definition Hive_Parametric_Inputs.gh (Grasshopper 1.0.7)
# plug-ins: HiveIO, sia380Parameters

list = ValueList({"1.2 Wohnen Einfamilienhaus"}, selected="1.2 Wohnen Einfamilienhaus")
number_slider = Slider(0.25, range=0..1)
rooms_existing = RoomsExisting({"1.1 Wohnen Mehrfamilienhaus": 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, "1.2 Wohnen Einfamilienhaus": {"description": "1.2 Wohnen Einfamilienhaus", "Raumlufttemperatur Auslegung Heizen (Winter)": 21.0, "Nettogeschossflaeche": 20.0, "Thermische Gebaeudehuellflaeche": 38.0, "U-Wert Fenster": 1.5, "Waermeeintragsleistung Personen (bei 24.0 deg C, bzw. 70 W)": 1.3999999999999999, "Jaehrliche Vollaststunden der Geraete": 1780.0, "U-Wert opake Bauteile": 0.80000000000000004, "Jaehrliche Vollaststunden der Raumbeleuchtung": 1450.0, "Vollaststunden pro Jahr (Personen)": 4090.0, "Abminderungsfaktor fuer Fensterrahmen": 0.75, "Aussenluft-Volumenstrom durch Infiltration": 0.29999999999999999, "Raumlufttemperatur Auslegung Kuehlung (Sommer)": 26.0, "Glasanteil": 30.0, "Zeitkonstante": 56.0, "Waermeeintragsleistung der Raumbeleuchtung": 2.7000000000000002, "Waermeeintragsleistung der Geraete": 10.0, "Gesamtenergiedurchlassgrad Verglasung": 0.65000000000000002, "Temperatur-Aenderungsgrad der Waermerueckgewinnung": NaN, "Aussenluft-Volumenstrom (pro NGF)": 0.59999999999999998}, "2.1 Hotelzimmer": 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, "2.2 Empfang, Lobby": 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, "3.1 Einzel-, Gruppenbuero": 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, "3.2 Grossraumbuero": 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, "3.3 Sitzungszimmer": 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, "3.4 Schalterhalle, Empfang": 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, "4.1 Schulzimmer": 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, "4.2 Lehrerzimmer": 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}, selected="1.2 Wohnen Einfamilienhaus")
mesh = Mesh(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)
number_slider_2 = Slider(0.25, range=0..100)
number_slider_3 = Slider(0.25, range=0..100)
number_slider_4 = Slider(0.25, range=0..100)
srf = Surface([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])
brep = Brep(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)
nickname = GhParametricInputEnergySystems(
    ASHPCapacity=number_slider_4,
    ASHPCost=number_slider_4,
    ASHPEmissions=number_slider_4,
    ASHPCOP=number_slider_4,
    NGBoilerCapacity=number_slider_2,
    NGBoilerCost=number_slider_2,
    NGBoilerEmissions=number_slider_2,
    NGBoilerEfficiency=number_slider_2,
    CHPCapacity=number_slider_3,
    CHPCost=number_slider_3,
    CHPEmissions=number_slider_3,
    CHPHTP=number_slider_3,
    CHPEffElec=number_slider_3)
nickname_2 = GhParametricInputSolarSystems(
    Mesh=mesh,
    Type="PV",
    Technology="A/S wow tech",
    EfficiencyElectric="0.3",
    EfficiencyThermal="0.0",
    InvestmentCost="3000",
    EmbodiedEmissions="200")  # -> Mesh, Json
nickname_3 = GhParametricInputSIARoom(
    Descriptiont=list,
    RoomConstant=Slider(50, range=50..300),
    CoolingSetpoint=Slider(16, range=16..30),
    HeatingSetpoint=Slider(16, range=16..30),
    FloorArea=number_slider,
    EnvelopeArea=number_slider,
    GlazingRatio=number_slider,
    UValueOpaque=number_slider,
    UValueTransparent=number_slider,
    GValue=number_slider,
    WindowFrameReduction=number_slider,
    AirChangeRate=number_slider,
    Infiltration=number_slider,
    HeatRecovery=number_slider,
    OccupantLoads=number_slider,
    LightingLoads=number_slider,
    EquipmentLoads=number_slider,
    OccupantYearlyHours=number_slider,
    LightingYearlyHours=number_slider,
    EquipmentYearlyHours=number_slider,
    OpaqueCost=number_slider,
    TransparentCost=number_slider,
    OpaqueEmissions=number_slider,
    TransparentEmissions=number_slider)
panel = Panel(nickname_2.Json)
panel_2 = Panel(nickname_3)
panel_3 = Panel(nickname)
hive_io_bldg = HiveIOBuilding(ZoneBrepGeometries=brep, WindowsSurfaces=srf, SIA2024Room=nickname_3)
panel_4 = Panel(hive_io_bldg)
